# Dynamo graph GetPath.dyn (Dynamo 2.12.0.5650)

file_path = Filename(".\nx_graph.json")
python_script = Python(IN[0]=file_path)  # CPython3
# ---------- python_script.python (23 lines) ----------
import sys, clr, json
sys.path.append(r'C:\Users\shota\.conda\envs\Dynamo383\Lib\site-packages')
import networkx as nx
from itertools import combinations
import matplotlib
import matplotlib.pyplot as plt


def read_json_file(path):
    with open("C:\Users\shota\Downloads\nx_graph.json", "r", encoding="utf-8") as json_file:
        json_data = json.load(json_file)
    return json_data

def draw_graph(graph):
    pos = {i : [tag["x"], tag["y"]] for i, tag in graph.nodes(data=True)}
    nx.draw_networkx(graph, pos, with_labels=False, alpha=0.5, edge_color='steelblue', node_color='steelblue')
    plt.axis("off")
    plt.show()
    

graph = read_json_file(IN[0])
OUT = graph
#draw_graph(graph)
# ----------------------------------------

# group: export json graph networkx file
directory_path = Directory("C:\Users\shota\Downloads")
file_name = StringInput("nx_graph")
code_block = CodeBlock(path=directory_path, name=file_name) { path + "\\" + name + ".json"; }
stringifyJSON = Data.StringifyJSON(values=python_script)
writeText = FileSystem.WriteText(filePath=code_block, text=stringifyJSON)

watch = Watch(file_path)
file_from_path = FileObject(path=file_path)
parseJSON = Data.ParseJSON(json=file_from_path)
