# Dynamo graph GetGraph.dyn "GetPath" (Dynamo 2.12.0.5650)
# packages: Clockwork for Dynamo 2.x 2.4.0

# group: get doors and rooms
categories = Categories("OST_Doors")
all_elements_of_category = ElementsOfCategory(Category=categories)
categories_2 = Categories("OST_Rooms")
all_elements_of_category_2 = ElementsOfCategory(Category=categories_2)
doors = Custom[Room.Doors](room=all_elements_of_category_2)  # package Clockwork for Dynamo 2.x; Retrieves all doors that are associated with a room (hosted in walls and roofs).

python_script = Python(IN[0]=all_elements_of_category, IN[1]=all_elements_of_category_2, IN[2]=doors)  # CPython3; frozen
# ---------- python_script.python (57 lines) ----------
import sys, clr
sys.path.append(r'C:\Users\shota\.conda\envs\Dynamo383\Lib\site-packages')
import networkx as nx
from itertools import combinations
import matplotlib
import matplotlib.pyplot as plt
matplotlib.rc('font', family='MS Gothic')

# dynamoノード
clr.AddReference("RevitNodes")
from Revit import Application
from Revit import Elements


def get_length(elem1, elem2):
    try: 
        view = Application.Document.Current.ActiveView
        path = Elements.PathOfTravel.ByFloorPlanPoints(view, [elem1.Location], [elem2.Location], False)
        distance = int(path[0].GetParameterValueByName("長さ"))
    except: return 0
    return distance
    

def get_graph(doors, rooms, room_doors):
    graph = nx.Graph()
    # node
    for room in rooms:
        graph.add_node(room.Name, x=room.Location.X, y=room.Location.Y)
    for door in doors:
        graph.add_node(str(door.Id), x=door.Location.X, y=door.Location.Y)
    # edge
    for room, doors in zip(rooms, room_doors):
        # ドア間の経路を追加
        for door1, door2 in combinations(doors, 2):
            distance = get_length(door1, door2)
            if distance == 0: continue
            graph.add_edge(str(door1.Id), str(door2.Id), weight=distance, name=room.Name)
        # 部屋からドアへの経路を追加
        for door in doors:
            distance = get_length(room, door)
            if distance == 0: continue
            graph.add_edge(room.Name, str(door.Id), weight=distance, name=room.Name)
    return graph


def draw_graph(graph):
    pos = {i : [tag["x"], tag["y"]] for i, tag in graph.nodes(data=True)}
    edge_labels = {(i, j) : str(tag["weight"])+"\n"+tag["name"]  for i, j, tag in graph.edges(data=True)}
    nx.draw_networkx_edge_labels(graph, pos, edge_labels=edge_labels, font_color='blueviolet', font_family="MS Gothic")
    nx.draw_networkx(graph, pos, with_labels=False, alpha=0.5, edge_color="steelblue", node_color="steelblue")
    plt.axis("off")
    plt.show()
    
    
graph = get_graph(IN[0], IN[1], IN[2])
draw_graph(graph)
OUT = nx.readwrite.json_graph.node_link_data(graph)
# ----------------------------------------

# group: export json graph networkx file
directory_path = Directory("C:\Users\shota\Downloads")
file_name = StringInput("nx_graph")
code_block = CodeBlock(path=directory_path, name=file_name) { path + "\\" + name + ".json"; }
stringifyJSON = Data.StringifyJSON(values=python_script)
writeText = FileSystem.WriteText(filePath=code_block, text=stringifyJSON)

categories_3 = Categories("OST_Rooms")
all_elements_of_category_3 = ElementsOfCategory(Category=categories_3)
code_block_2 = CodeBlock(rooms=all_elements_of_category_3) { rooms[0]; rooms[2]; }
python_script_2 = Python(IN[0]=code_block_2.out0, IN[1]=code_block_2.out1)  # CPython3
# ---------- python_script_2.python (14 lines) ----------
# dynamoノード
import clr
clr.AddReference("RevitNodes")
from Revit import Application
from Revit import Elements


def get_length(elem1, elem2):
    view = Application.Document.Current.ActiveView
    path = Elements.PathOfTravel.ByFloorPlanPoints(view, [elem1.Location], [elem2.Location], False)
    distance = int(path[0].GetParameterValueByName("長さ"))
    return distance
    
OUT = get_length(IN[0], IN[1])
# ----------------------------------------
